# Grasshopper definition test_result.gh (Grasshopper 1.0.8)
# plug-ins: OrigamiCraneGH

mesh = Mesh(<mesh referenced from the Rhino model>)
extractcomponent = ExtractComponent(Mesh=mesh)
c_script = CSharpScript(x=mesh)  # -> out, a; inputs x: Mesh
# ---------- c_script: C# ----------
// Grasshopper Script Instance
#region Usings
using System;
using System.Linq;
using System.Collections;
using System.Collections.Generic;
using System.Drawing;

using Rhino;
using Rhino.Geometry;

using Grasshopper;
using Grasshopper.Kernel;
using Grasshopper.Kernel.Data;
using Grasshopper.Kernel.Types;
#endregion

public class Script_Instance : GH_ScriptInstance
{
    #region Notes
    /* 
      Members:
        RhinoDoc RhinoDocument
        GH_Document GrasshopperDocument
        IGH_Component Component
        int Iteration

      Methods (Virtual & overridable):
        Print(string text)
        Print(string format, params object[] args)
        Reflect(object obj)
        Reflect(object obj, string method_name)
    */
    #endregion

    private void RunScript(Mesh x, object y, ref object a)
    {
        var mList = x.Vertices;
        Console.WriteLine(mList.GetType());
        Console.WriteLine(mList.Count);
        a = mList;
    }
}
# ---------- end c_script ----------
panel = Panel(extractcomponent)
panel_2 = Panel(c_script.a)
